# Dynamo graph Floor-Beam to Beam.dyn (Dynamo 2.2.1.5175)

# group: Select input elements and structure them into connection nodes and take sub nodes of 2 elements.
select_steel_elements = SelectStructureData()  # 15 picked in the model; graph input
byObjects = AdvanceSteel.ConnectionAutomation.Nodes.ConnectionNode.FromStructure(objects=select_steel_elements)  # "Node.ByObjects"
code_block = CodeBlock { 2; }
getSubNodesOfSize = AdvanceSteel.ConnectionAutomation.Nodes.ConnectionNode.SubNodesOfSize(node=byObjects, noOfZones=code_block)  # "Node.GetSubNodesOfSize"

# group: Define the zone for which the secondary element joins with the main input element.
code_block_2 = CodeBlock { 1; "End"; }
byZoneType = AdvanceSteel.ConnectionAutomation.Nodes.Filter.ByZoneType(node=getSubNodesOfSize, index=code_block_2.out0, zoneType=code_block_2.out1)

# group: Filter nodes of input elements by Section Name.
code_block_3 = CodeBlock { 0; }
main_element_family_type = StructuralDataTypes("Any | Any")  # graph input
bySectionName = AdvanceSteel.ConnectionAutomation.Nodes.Filter.BySectionType(node=byZoneType.accepted, index=code_block_3, nameToFind=main_element_family_type.typeName)  # "Filter.BySectionName"
code_block_4 = CodeBlock { 1; }
second_element_family_type = StructuralDataTypes("Any | Any")  # graph input
bySectionName_2 = AdvanceSteel.ConnectionAutomation.Nodes.Filter.BySectionType(node=bySectionName.accepted, index=code_block_4, nameToFind=second_element_family_type.typeName)  # "Filter.BySectionName"

# group: Filter nodes of input elements based on slope angle for main and for secondary input element. When slope range is 0-0, the filtered input elements are horizontal.
code_block_5 = CodeBlock { 0; }
main_element_slope_angle_range = DoubleInput(0)  # "Main element slope angle. Range start from"; graph input
main_element_slope_angle_range_2 = DoubleInput(0)  # "Main element slope angle. Range end to"; graph input
bySlopeAngle = AdvanceSteel.ConnectionAutomation.Nodes.Filter.BySlopeAngle(node=bySectionName_2.accepted, index=code_block_5, rangeStart=main_element_slope_angle_range, rangeEnd=main_element_slope_angle_range_2)
code_block_6 = CodeBlock { 1; }
second_element_slope_angle_range = DoubleInput(0)  # "Second element slope angle. Range start from"; graph input
second_element_slope_angle_range_2 = DoubleInput(0)  # "Second element slope angle. Range end to"; graph input
bySlopeAngle_2 = AdvanceSteel.ConnectionAutomation.Nodes.Filter.BySlopeAngle(node=bySlopeAngle.accepted, index=code_block_6, rangeStart=second_element_slope_angle_range, rangeEnd=second_element_slope_angle_range_2)

# group: Filter nodes of input elements based on angle between axes of main and secondary element.
code_block_7 = CodeBlock { 0; 1; }
angle_between_1st_and_2nd = DoubleInput(0)  # "Angle between 1st and 2nd element. Range start from"; graph input
angle_between_1st_and_2nd_2 = DoubleInput(90)  # "Angle between 1st and 2nd element. Range end to"; graph input
byAngleBetweenBeams = AdvanceSteel.ConnectionAutomation.Nodes.Filter.ByAngleBetweenBeams(node=bySlopeAngle_2.accepted, indexFirst=code_block_7.out0, indexSecond=code_block_7.out1, rangeStart=angle_between_1st_and_2nd, rangeEnd=angle_between_1st_and_2nd_2)

# group: Create Moment end Plate connection taking indexes as order for input elements.
code_block_8 = CodeBlock { [0,1]; }
connection_type_to_add_in_model = ConnectionTypes("FLOOR BEAM | FLOOR BEAM")  # graph input
byType = AdvanceSteel.ConnectionAutomation.Nodes.Connection.ByType(node=byAngleBetweenBeams.accepted, indexes=code_block_8, connectionType=connection_type_to_add_in_model)

# group: Display number of created connections per run.
code_block_9 = CodeBlock { false; }
clean = List.Clean(list=byType, preserveIndices=code_block_9)
flatten = List.Flatten(list=clean)
count = List.Count(list=flatten)
number_of_created_connections = Watch(count)  # graph output
