# Dynamo graph Floor-Generate Cold-formed Steel Structure.dyn "Floor-Generate Cold formed Steel Structure" (Dynamo 2.2.1.5175)

flip_edge_beam = BoolSelector(false)  # graph input

# group: INPUT
select_model_elements = DSModelElementsSelection()  # 1 picked in the model; graph input
levels_of_bottom_of_the_wall = Levels("FLOOR")  # graph input
gap_between_wall_and_floor = LengthFromString(Value=0.018288)
floor_beam = FamilyTypes("CC BEAM V:1")  # graph input
space_between_floor_beams = LengthFromString(Value=0.3048)  # graph input
minimum_space_between_beams = LengthFromString(Value=0.127)  # graph input

# group: FILTER OUT LINES
code_block = CodeBlock { "Lines"; }
getCategory = Element.GetCategory(element=select_model_elements)
name = Category.Name(category=getCategory)
eq = code_block == name
filterByBoolMask = List.FilterByBoolMask(list=select_model_elements, mask=eq)

# group: GET CURVE
curves = Element.Curves(element=filterByBoolMask.in)

endPoint = Curve.EndPoint(curve=curves)
startPoint = Curve.StartPoint(curve=curves)
byStartPointEndPoint = Line.ByStartPointEndPoint(startPoint=endPoint, endPoint=startPoint)
python_script = Python(IN[0]=flip_edge_beam, IN[1]=byStartPointEndPoint, IN[2]=curves)
# ---------- python_script.python (15 lines) ----------
# Load the Python Standard and DesignScript Libraries
import sys
import clr
clr.AddReference('ProtoGeometry')
from Autodesk.DesignScript.Geometry import *

# The inputs to this node will be stored as a list in the IN variables.
dataEnteringNode = IN

# Place your code below this line
if IN[0]:
	OUT=IN[1]
else:
	OUT=IN[2]
# Assign your output to the OUT variable.
# ----------------------------------------

# group (continued): GET CURVE
byJoinedCurves = PolyCurve.ByJoinedCurves(curves=python_script)
curves_2 = PolyCurve.Curves(polyCurve=byJoinedCurves)
flatten = List.Flatten(list=curves_2)

# group: FLOOR EDGE BEAM
XY = Plane.XY()
elevation = Level.Elevation(level=levels_of_bottom_of_the_wall)
code_block_2 = CodeBlock(x=elevation, y=gap_between_wall_and_floor) { x-y; }
offset = Plane.Offset(plane=XY, dist=code_block_2)
pullOntoPlane = Curve.PullOntoPlane(curve=flatten, plane=offset)
beamByCurve = StructuralFraming.BeamByCurve(curve=pullOntoPlane, level=levels_of_bottom_of_the_wall, structuralFramingType=floor_beam)

# group: GET DIRECTION OF CURVE
startPoint_2 = Curve.StartPoint(curve=flatten)
endPoint_2 = Curve.EndPoint(curve=flatten)
byTwoPoints = Vector.ByTwoPoints(start=startPoint_2, end=endPoint_2)
XAxis = Vector.XAxis()
isParallel = Vector.IsParallel(vector=byTwoPoints, other=XAxis)
filterByBoolMask_2 = List.FilterByBoolMask(list=flatten, mask=isParallel)

# group: FLOOR BEAM
flatten_2 = List.Flatten(list=curves)
byJoinedCurves_2 = PolyCurve.ByJoinedCurves(curves=flatten_2)
pullOntoPlane_2 = Curve.PullOntoPlane(curve=byJoinedCurves_2, plane=offset)
byPatch = Surface.ByPatch(closedCurve=pullOntoPlane_2)
direction_of_floor_beams = BoolSelector(true)  # graph input
x_curve = Curve.PullOntoPlane(curve=filterByBoolMask_2.in, plane=offset)
y_curve = Curve.PullOntoPlane(curve=filterByBoolMask_2.out, plane=offset)
python_script_2 = Python(IN[0]=direction_of_floor_beams, IN[1]=x_curve, IN[2]=y_curve)  # same code as python_script
startPoint_3 = Curve.StartPoint(curve=python_script_2)
flatten_3 = List.Flatten(list=startPoint_3)
endPoint_3 = Curve.EndPoint(curve=python_script_2)
flatten_4 = List.Flatten(list=endPoint_3)
join = List.Join(list0=flatten_3, list1=flatten_4)
X = Point.X(point=join)
flatten_5 = List.Flatten(list=X)
maximumItem = List.MaximumItem(list=flatten_5)
Y = Point.Y(point=join)
flatten_6 = List.Flatten(list=Y)
maximumItem_2 = List.MaximumItem(list=flatten_6)
minimumItem = List.MinimumItem(list=flatten_5)
minimumItem_2 = List.MinimumItem(list=flatten_6)
code_block_3 = CodeBlock(XMAX=maximumItem, YMAX=maximumItem_2, XMIN=minimumItem, YMIN=minimumItem_2) { XMAX; YMAX; XMIN; YMIN; }
code_block_4 = CodeBlock(Z=code_block_2) { Z; }
n1 = Point.ByCoordinates(x=code_block_3.XMIN, y=code_block_3.YMIN, z=code_block_4)  # "1"
n2 = Point.ByCoordinates(x=code_block_3.XMAX, y=code_block_3.YMIN, z=code_block_4)  # "2"
byStartPointEndPoint_2 = Line.ByStartPointEndPoint(startPoint=n1, endPoint=n2)
n4 = Point.ByCoordinates(x=code_block_3.XMAX, y=code_block_3.YMAX, z=code_block_4)  # "4"
byStartPointEndPoint_3 = Line.ByStartPointEndPoint(startPoint=n2, endPoint=n4)
n3 = Point.ByCoordinates(x=code_block_3.XMIN, y=code_block_3.YMAX, z=code_block_4)  # "3"
byStartPointEndPoint_4 = Line.ByStartPointEndPoint(startPoint=n4, endPoint=n3)
byStartPointEndPoint_5 = Line.ByStartPointEndPoint(startPoint=n3, endPoint=n1)
join_2 = List.Join(list0=byStartPointEndPoint_2, list1=byStartPointEndPoint_3, list2=byStartPointEndPoint_4, list3=byStartPointEndPoint_5)
byTwoPoints_2 = Vector.ByTwoPoints(start=n1, end=n2)
byTwoPoints_3 = Vector.ByTwoPoints(start=n2, end=n4)
byTwoPoints_4 = Vector.ByTwoPoints(start=n4, end=n3)
byTwoPoints_5 = Vector.ByTwoPoints(start=n3, end=n1)
join_3 = List.Join(list0=byTwoPoints_2, list1=byTwoPoints_3, list2=byTwoPoints_4, list3=byTwoPoints_5)
XAxis_2 = Vector.XAxis()
YAxis = Vector.YAxis()
python_script_3 = Python(IN[0]=direction_of_floor_beams, IN[1]=XAxis_2, IN[2]=YAxis)  # same code as python_script
isParallel_2 = Vector.IsParallel(vector=join_3, other=python_script_3)
filterByBoolMask_3 = List.FilterByBoolMask(list=join_2, mask=isParallel_2)
upgrade = Python(IN[0]=filterByBoolMask_3.in)
# ---------- upgrade.python (15 lines) ----------
# Load the Python Standard and DesignScript Libraries
import sys
import clr
clr.AddReference('ProtoGeometry')
from Autodesk.DesignScript.Geometry import *

# The inputs to this node will be stored as a list in the IN variables.
dataEnteringNode = IN

# Place your code below this line
a=[]
for n in IN[0]:
	a.append([n])
# Assign your output to the OUT variable.
OUT = a
# ----------------------------------------
byJoinedCurves_3 = PolyCurve.ByJoinedCurves(curves=upgrade)
curves_3 = PolyCurve.Curves(polyCurve=byJoinedCurves_3)
flatten_7 = List.Flatten(list=curves_3)
length = Curve.Length(curve=flatten_7)
code_block_5 = CodeBlock { 2; }
div = length / code_block_5
pointAtSegmentLength = Curve.PointAtSegmentLength(curve=flatten_7, segmentLength=div)
pointsAtSegmentLengthFromPoint = Curve.PointsAtSegmentLengthFromPoint(curve=flatten_7, point=pointAtSegmentLength, segmentLength=space_between_floor_beams)
startPoint_4 = Curve.StartPoint(curve=flatten_7)
endPoint_4 = Curve.EndPoint(curve=flatten_7)
ZIP = Python(IN[0]=startPoint_4, IN[1]=endPoint_4)
# ---------- ZIP.python (15 lines) ----------
# Enable Python support and load DesignScript library
import clr
clr.AddReference('ProtoGeometry')
from Autodesk.DesignScript.Geometry import *

# The inputs to this node will be stored as a list in the IN variables.
dataEnteringNode = IN
A=[]
# Place your code below this line
for i in range(len(IN[0])):
	A.append([])
	A[i].append(IN[0][i])
	A[i].append(IN[1][i])
# Assign your output to the OUT variable.
OUT = A
# ----------------------------------------
upgrade_and_duplicate_list = Python(IN[0]=ZIP, IN[1]=pointsAtSegmentLengthFromPoint)
# ---------- upgrade_and_duplicate_list.python (17 lines) ----------
# Load the Python Standard and DesignScript Libraries
import sys
import clr
clr.AddReference('ProtoGeometry')
from Autodesk.DesignScript.Geometry import *

# The inputs to this node will be stored as a list in the IN variables.
dataEnteringNode = IN

# Place your code below this line
a=[]
for i in range(len(IN[1])):
	a.append([])
	for j in range(len(IN[1][i])):
		a[i].append(IN[0][i])
# Assign your output to the OUT variable.
OUT = a
# ----------------------------------------
byTwoPoints_6 = Vector.ByTwoPoints(start=upgrade_and_duplicate_list, end=pointsAtSegmentLengthFromPoint)
length_2 = Vector.Length(vector=byTwoPoints_6)
lt = length_2 < minimum_space_between_beams
python_script_4 = Python(IN[0]=lt)
# ---------- python_script_4.python (24 lines) ----------
# Load the Python Standard and DesignScript Libraries
import sys
import clr
clr.AddReference('ProtoGeometry')
from Autodesk.DesignScript.Geometry import *

# The inputs to this node will be stored as a list in the IN variables.
dataEnteringNode = IN

# Place your code below this line
a=[]
for i in range(len(IN[0])):
	a.append ([])
	for j in range(len(IN[0][i])):
		for n in IN[0][i][j]:
			f=0
			if n==True:
				a[i].append(True)
				f=1
				break
		if f==0:
				a[i].append(False)
# Assign your output to the OUT variable.
OUT = a
# ----------------------------------------
filterByBoolMask_4 = List.FilterByBoolMask(list=pointsAtSegmentLengthFromPoint, mask=python_script_4)
code_block_6 = CodeBlock { 0; 1; }
getItemAtIndex = List.GetItemAtIndex(list=filterByBoolMask_4.out, index=code_block_6.out1)
reverse = List.Reverse(list=getItemAtIndex)
getItemAtIndex_2 = List.GetItemAtIndex(list=filterByBoolMask_4.out, index=code_block_6.out0)
byStartPointEndPoint_6 = Line.ByStartPointEndPoint(startPoint=reverse, endPoint=getItemAtIndex_2)
byStartPointEndPoint_7 = Line.ByStartPointEndPoint(startPoint=getItemAtIndex_2, endPoint=reverse)
python_script_5 = Python(IN[0]=byStartPointEndPoint_6, IN[1]=byStartPointEndPoint_7)
# ---------- python_script_5.python (22 lines) ----------
# Load the Python Standard and DesignScript Libraries
import sys
import clr
clr.AddReference('ProtoGeometry')
from Autodesk.DesignScript.Geometry import *

# The inputs to this node will be stored as a list in the IN variables.
dataEnteringNode = IN

# Place your code below this line
a=len(IN[0])

new=[]
for l in range(a):
	new.append ("")
for i in range( 0, len(IN[0]),2):
	new[i]= (IN[0][i])
for j in range( 1, len(IN[0]),2):
	new[j]=(IN[1][j])

# Assign your output to the OUT variable.
OUT = new
# ----------------------------------------
upgrade_2 = Python(IN[0]=python_script_5)  # same code as upgrade
byJoinedCurves_4 = PolyCurve.ByJoinedCurves(curves=upgrade_2)
curves_4 = PolyCurve.Curves(polyCurve=byJoinedCurves_4)
flatten_8 = List.Flatten(list=curves_4)
intersect = Geometry.Intersect(geometry=byPatch, other=flatten_8)
beamByCurve_2 = StructuralFraming.BeamByCurve(curve=intersect, level=levels_of_bottom_of_the_wall, structuralFramingType=floor_beam)

# group: DELETE CLASHED BEAMS
delete_clashed_floor_beam = BoolSelector(true)  # graph input
python_script_6 = Python(IN[0]=beamByCurve_2, IN[1]=delete_clashed_floor_beam)
# ---------- python_script_6.python (16 lines) ----------
# Load the Python Standard and DesignScript Libraries
import sys
import clr
clr.AddReference('ProtoGeometry')
from Autodesk.DesignScript.Geometry import *

# The inputs to this node will be stored as a list in the IN variables.
dataEnteringNode = IN

# Place your code below this line

# Assign your output to the OUT variable.
if IN[1]:
	OUT=IN[0]
else:
	OUT=[]
# ----------------------------------------
flatten_9 = List.Flatten(list=python_script_6)
intersectsElement = Revit.Element.IntersectsElement(elementSetA=beamByCurve, elementSetB=flatten_9, lacing=CrossProduct)
python_script_7 = Python(IN[0]=intersectsElement.Element)
# ---------- python_script_7.python (21 lines) ----------
# Load the Python Standard and DesignScript Libraries
import sys
import clr
clr.AddReference('ProtoGeometry')
from Autodesk.DesignScript.Geometry import *

# The inputs to this node will be stored as a list in the IN variables.
dataEnteringNode = IN

# Place your code below this line
a=[]
for d in IN[0]:
	for n in d:
		for m in n:
			if m!=[]:
				for p in m:
					a.append (p)

OUT=a

# Assign your output to the OUT variable.
# ----------------------------------------
start = Revit.Transaction.Transaction.Start(input=python_script_7)
delete = archilab.Revit.Elements.Elements.Delete(element=start)
end = Revit.Transaction.Transaction.End(input=delete)

# group: CREATE MIDDLE BEAM BETWEEN FLOOR BEAM
python_script_8 = Python(IN[0]=intersect)
# ---------- python_script_8.python (20 lines) ----------
# Load the Python Standard and DesignScript Libraries
import sys
import clr
clr.AddReference('ProtoGeometry')
from Autodesk.DesignScript.Geometry import *

# The inputs to this node will be stored as a list in the IN variables.
dataEnteringNode = IN

# Place your code below this line


new=[]

for i in range( 0, len(IN[0]),2):
	new.append(IN[0][i])


# Assign your output to the OUT variable.
OUT = new
# ----------------------------------------
code_block_7 = CodeBlock { 0.5; }
pointAtParameter = Curve.PointAtParameter(curve=python_script_8, param=code_block_7)
python_script_9 = Python(IN[0]=intersect)
# ---------- python_script_9.python (20 lines) ----------
# Load the Python Standard and DesignScript Libraries
import sys
import clr
clr.AddReference('ProtoGeometry')
from Autodesk.DesignScript.Geometry import *

# The inputs to this node will be stored as a list in the IN variables.
dataEnteringNode = IN

# Place your code below this line


new=[]

for i in range( 1, len(IN[0]),2):
	new.append(IN[0][i])


# Assign your output to the OUT variable.
OUT = new
# ----------------------------------------
reverse_2 = List.Reverse(list=python_script_9@@L2)
pointAtParameter_2 = Curve.PointAtParameter(curve=reverse_2, param=code_block_7)
python_script_10 = Python(IN[0]=pointAtParameter, IN[1]=pointAtParameter_2)
# ---------- python_script_10.python (20 lines) ----------
# Load the Python Standard and DesignScript Libraries
import sys
import clr
clr.AddReference('ProtoGeometry')
from Autodesk.DesignScript.Geometry import *

# The inputs to this node will be stored as a list in the IN variables.
dataEnteringNode = IN

# Place your code below this line
a=[]
b=len(IN[0])-1

for i in range(len(IN[1])):
	a.append ([])
	if i <=b:
		for j in range(len(IN[0][i])):
			a[i].append(IN[1][i])
# Assign your output to the OUT variable.
OUT = a
# ----------------------------------------
byStartPointEndPoint_8 = Line.ByStartPointEndPoint(startPoint=pointAtParameter, endPoint=python_script_10)
byTwoPoints_7 = Vector.ByTwoPoints(start=pointAtParameter, end=python_script_10)
isParallel_3 = Vector.IsParallel(vector=byTwoPoints_7, other=python_script_3)
filterByBoolMask_5 = List.FilterByBoolMask(list=byStartPointEndPoint_8, mask=isParallel_3)
flatten_10 = List.Flatten(list=filterByBoolMask_5.in)
beamByCurve_3 = StructuralFraming.BeamByCurve(curve=flatten_10, level=levels_of_bottom_of_the_wall, structuralFramingType=floor_beam)

end_2 = Revit.Transaction.Transaction.End()  # unwired: input
