# Dynamo graph Wall-Beam to Column.dyn (Dynamo 2.2.1.5175)

# group: Select input elements and structure them into connection nodes and take sub nodes of 2 elements.
select_steel_elements = SelectStructureData()  # 92 picked in the model; graph input
byObjects = AdvanceSteel.ConnectionAutomation.Nodes.ConnectionNode.FromStructure(objects=select_steel_elements)  # "Node.ByObjects"
code_block = CodeBlock { 2; }
getSubNodesOfSize = AdvanceSteel.ConnectionAutomation.Nodes.ConnectionNode.SubNodesOfSize(node=byObjects, noOfZones=code_block)  # "Node.GetSubNodesOfSize"

# group: Define the zones for which the elements are joining to each other to create a connection.
code_block_2 = CodeBlock { 0; "Body"; }
byZoneType = AdvanceSteel.ConnectionAutomation.Nodes.Filter.ByZoneType(node=getSubNodesOfSize, index=code_block_2.out0, zoneType=code_block_2.out1)
code_block_3 = CodeBlock { 1; "End"; }
byZoneType_2 = AdvanceSteel.ConnectionAutomation.Nodes.Filter.ByZoneType(node=byZoneType.accepted, index=code_block_3.out0, zoneType=code_block_3.out1)

# group: Filter main input elements based on slant angle. For a range of 0 to 0 it identifies situations where the main input element is horizontal. By increasing the range it will identify slanted columns as well.
code_block_4 = CodeBlock { 0; }
slant_angle_for_main_input = DoubleInput(0)  # "Slant angle for main input element. Range start from"
slant_angle_for_main_input_2 = DoubleInput(0)  # "Slant angle for main input element. Range end to"
bySlantAngle = AdvanceSteel.ConnectionAutomation.Nodes.Filter.BySlantAngle(node=byZoneType_2.accepted, index=code_block_4, rangeStart=slant_angle_for_main_input, rangeEnd=slant_angle_for_main_input_2)

# group: Filter accepted input elements, based on Section Name.
code_block_5 = CodeBlock { 0; }
main_element_type = StructuralDataTypes("Any | Any")  # graph input
bySectionName = AdvanceSteel.ConnectionAutomation.Nodes.Filter.BySectionType(node=bySlantAngle.accepted, index=code_block_5, nameToFind=main_element_type.typeName)  # "Filter.BySectionName"
code_block_6 = CodeBlock { 1; }
secondary_element_type = StructuralDataTypes("Any | Any")  # graph input
bySectionName_2 = AdvanceSteel.ConnectionAutomation.Nodes.Filter.BySectionType(node=bySectionName.accepted, index=code_block_6, nameToFind=secondary_element_type.typeName)  # "Filter.BySectionName"

# group: Filter input elements to identify the beam orientation cases supported by the clip angle connection using a filter for the angle made by the vectors of the input elements axis. E.g: the clip angle connection connects the main and second elements using straight angle cleats, the connection is not created if the cleats need to be skewed in order to connect the input elements.
code_block_7 = CodeBlock { 0; 1; "y"; "y"; 89; 90; }
byAngleBetweenAxes = AdvanceSteel.ConnectionAutomation.Nodes.Filter.ByAngleBetweenAxes(node=bySectionName_2.accepted, indexFirst=code_block_7.out0, indexSecond=code_block_7.out1, axisFirst=code_block_7.out2, axisSecond=code_block_7.out3, rangeStart=code_block_7.out4, rangeEnd=code_block_7.out5)
code_block_8 = CodeBlock { 0; 1; "y"; "y"; 0; 1; }
byAngleBetweenAxes_2 = AdvanceSteel.ConnectionAutomation.Nodes.Filter.ByAngleBetweenAxes(node=byAngleBetweenAxes.rejected, indexFirst=code_block_8.out0, indexSecond=code_block_8.out1, axisFirst=code_block_8.out2, axisSecond=code_block_8.out3, rangeStart=code_block_8.out4, rangeEnd=code_block_8.out5)
list_create = List.Create(item0=byAngleBetweenAxes.accepted, item1=byAngleBetweenAxes_2.accepted)

# group: Filter secondary input element by slope angle.
code_block_9 = CodeBlock { 1; }
slope_for_secondary_element = DoubleInput(0)  # "Slope for secondary element. Range start from"; graph input
slope_for_secondary_element_2 = DoubleInput(90)  # "Slope for secondary element. Range ends to"; graph input
bySlopeAngle = AdvanceSteel.ConnectionAutomation.Nodes.Filter.BySlopeAngle(node=list_create, index=code_block_9, rangeStart=slope_for_secondary_element, rangeEnd=slope_for_secondary_element_2)

# group: Create Clip Angle connection taking indexes as order for input elements.
code_block_10 = CodeBlock { [0,1]; }
connection_type_to_add_in_model = ConnectionTypes("BEAM AND COLUMN LIGHT STEEL | BEAM AND COLUMN LIGHT STEEL")  # graph input
byType = AdvanceSteel.ConnectionAutomation.Nodes.Connection.ByType(node=bySlopeAngle.accepted, indexes=code_block_10, connectionType=connection_type_to_add_in_model)

# group: Display number of created connections per run.
code_block_11 = CodeBlock { false; }
clean = List.Clean(list=byType, preserveIndices=code_block_11)
flatten = List.Flatten(list=clean)
count = List.Count(list=flatten)
number_of_created_connections = Watch(count)  # graph output
