# Dynamo graph Wall-Generate Cold-formed Steel Structure.dyn (Dynamo 2.2.1.5175)

# group: input
select_model_elements = DSModelElementsSelection()  # 4 picked in the model; graph input
levels_of_bottom_of_the_wall = Levels("FLOOR")  # graph input
column = FamilyTypes("Light Gauge-Studs-Column:1200S250-54")  # graph input
STRIPE = FamilyTypes("L Stripe:L1")  # graph input
place_stripe = BoolSelector(false)  # graph input
column_height = LengthFromString(Value=3.048)  # graph input
offset_of_stripes = LengthFromString(Value=0.01524)
space_between_column_at_corner = LengthFromString(Value=0.0127)  # graph input
space_between_column = LengthFromString(Value=0.4064)  # graph input
minimum_space_between_column = LengthFromString(Value=0.127)  # graph input
beam = FamilyTypes("Light Gauge-Runner Channels:RC2 11/16 2")  # graph input
height_of_top_beam_2 = LengthFromString(Value=2.7432)  # graph input
height_of_middle_beam = LengthFromString(Value=1.524)  # graph input

# group: FILTER OUT LINES
code_block = CodeBlock { "Lines"; }
getCategory = Element.GetCategory(element=select_model_elements)
name = Category.Name(category=getCategory)
eq = code_block == name
filterByBoolMask = List.FilterByBoolMask(list=select_model_elements, mask=eq)

# group: GET CURVE
curves = Element.Curves(element=filterByBoolMask.in)
byJoinedCurves = PolyCurve.ByJoinedCurves(curves=curves)
curves_2 = PolyCurve.Curves(polyCurve=byJoinedCurves)
flatten = List.Flatten(list=curves_2)

# group: GET DIRECTION OF CURVE
startPoint = Curve.StartPoint(curve=flatten)
endPoint = Curve.EndPoint(curve=flatten)
byTwoPoints = Vector.ByTwoPoints(start=startPoint, end=endPoint)
XAxis = Vector.XAxis()
isParallel = Vector.IsParallel(vector=byTwoPoints, other=XAxis)
filterByBoolMask_2 = List.FilterByBoolMask(list=flatten, mask=isParallel)

python_script = Python(IN[0]=STRIPE, IN[1]=place_stripe)
# ---------- python_script.python (16 lines) ----------
# 加载 Python Standard 和 DesignScript 库
import sys
import clr
clr.AddReference('ProtoGeometry')
from Autodesk.DesignScript.Geometry import *

# 该节点的输入内容将存储为 IN 变量中的一个列表。
dataEnteringNode = IN

# 将代码放在该行下面
if IN[1]:
	OUT=IN[0]
else:
	OUT=0

# 将输出内容指定给 OUT 变量。
# ----------------------------------------

# group: GET PARAMETER FROM COLUMN
code_block_2 = CodeBlock { "B"; }
getParameterValueByName = Element.GetParameterValueByName(element=column, parameterName=code_block_2)
code_block_3 = CodeBlock { "t1"; }
getParameterValueByName_2 = Element.GetParameterValueByName(element=python_script, parameterName=code_block_3)

COLUMNHEIGHT = CodeBlock(COLUMNHEIGHT=column_height) { COLUMNHEIGHT; }
length = Curve.Length(curve=filterByBoolMask_2.out)

# group: SHORTEN Y CURVE
y_curve = Python(IN[0]=filterByBoolMask_2.out)
# ---------- y_curve.python (13 lines) ----------
# Load the Python Standard and DesignScript Libraries
import sys
import clr
clr.AddReference('ProtoGeometry')
from Autodesk.DesignScript.Geometry import *

# The inputs to this node will be stored as a list in the IN variables.
dataEnteringNode = IN

# Place your code below this line

# Assign your output to the OUT variable.
OUT = IN[0]
# ----------------------------------------
upgrade = Python(IN[0]=y_curve)
# ---------- upgrade.python (15 lines) ----------
# Load the Python Standard and DesignScript Libraries
import sys
import clr
clr.AddReference('ProtoGeometry')
from Autodesk.DesignScript.Geometry import *

# The inputs to this node will be stored as a list in the IN variables.
dataEnteringNode = IN

# Place your code below this line
a=[]
for n in IN[0]:
	a.append([n])
# Assign your output to the OUT variable.
OUT = a
# ----------------------------------------
code_block_4 = CodeBlock { "B"; }
getParameterValueByName_3 = Element.GetParameterValueByName(element=column, parameterName=code_block_4)
code_block_5 = CodeBlock(B=getParameterValueByName_3) { B/2; }
pointAtSegmentLength = Curve.PointAtSegmentLength(curve=y_curve, segmentLength=code_block_5)
curve_length = Python(IN[0]=length)  # same code as y_curve
sub = curve_length - code_block_5
pointAtSegmentLength_2 = Curve.PointAtSegmentLength(curve=y_curve, segmentLength=sub)
ZIP = Python(IN[0]=pointAtSegmentLength, IN[1]=pointAtSegmentLength_2)
# ---------- ZIP.python (16 lines) ----------
# Enable Python support and load DesignScript library
import clr
clr.AddReference('ProtoGeometry')
from Autodesk.DesignScript.Geometry import *

# The inputs to this node will be stored as a list in the IN variables.
dataEnteringNode = IN

# Place your code below this line
a=[]
for i in range(len(IN[0])):
	a.append([])
	a[i].append(IN[0][i])
	a[i].append(IN[1][i])
# Assign your output to the OUT variable.
OUT = a
# ----------------------------------------
splitByPoints = Curve.SplitByPoints(curve=upgrade, points=ZIP)
python_script_2 = Python(IN[0]=splitByPoints)
# ---------- python_script_2.python (15 lines) ----------
# Load the Python Standard and DesignScript Libraries
import sys
import clr
clr.AddReference('ProtoGeometry')
from Autodesk.DesignScript.Geometry import *

# The inputs to this node will be stored as a list in the IN variables.
dataEnteringNode = IN

# Place your code below this line
a=[]
for n in IN[0]:
	a.append(n[0][1])

OUT = a
# ----------------------------------------

# group: Y ADD START AND END POINT TO LIST
endPoint_2 = Curve.EndPoint(curve=python_script_2)
startPoint_2 = Curve.StartPoint(curve=python_script_2)
flatten_2 = List.Flatten(list=startPoint_2)
flatten_3 = List.Flatten(list=endPoint_2)

# group: GET RIGHT SIDE OF Y
byTwoPoints_2 = Vector.ByTwoPoints(start=startPoint_2, end=endPoint_2)
normalized = Vector.Normalized(vector=byTwoPoints_2)
string_from_object = FromObject(obj=normalized)
YAxis = Vector.YAxis()
string_from_object_2 = FromObject(obj=YAxis)
eq_2 = string_from_object == string_from_object_2
end_point_inx_out_x = List.FilterByBoolMask(list=endPoint_2, mask=eq_2)
start_point_inx_out_x = List.FilterByBoolMask(list=startPoint_2, mask=eq_2)

# group: MOVE POINT TO TOP AND BOTTOM
X = Point.X(point=end_point_inx_out_x.out)
Y = Point.Y(point=end_point_inx_out_x.out)
elevation = Level.Elevation(level=levels_of_bottom_of_the_wall)
bottom_point = Point.ByCoordinates(x=X, y=Y, z=elevation)
code_block_6 = CodeBlock(x=elevation, y=COLUMNHEIGHT, z=offset_of_stripes) { x+y-z; }
top_point = Point.ByCoordinates(x=X, y=Y, z=code_block_6)

# group: MOVE POINTS ALONG -X
XAxis_2 = Vector.XAxis()
code_block_7 = CodeBlock(B=getParameterValueByName, t=getParameterValueByName_2) { (B/2+t); }
translate = Geometry.Translate(geometry=bottom_point, direction=XAxis_2, distance=code_block_7)
XAxis_3 = Vector.XAxis()
code_block_8 = CodeBlock(B=getParameterValueByName, t=getParameterValueByName_2) { (B/2+t); }
translate_2 = Geometry.Translate(geometry=top_point, direction=XAxis_3, distance=code_block_8)

# group: MOVE POINT TO TOP AND BOTTOM
X_2 = Point.X(point=start_point_inx_out_x.out)
Y_2 = Point.Y(point=start_point_inx_out_x.out)
elevation_2 = Level.Elevation(level=levels_of_bottom_of_the_wall)
code_block_9 = CodeBlock(x=elevation_2, y=COLUMNHEIGHT, z=offset_of_stripes) { x+y-z; }
top_point_2 = Point.ByCoordinates(x=X_2, y=Y_2, z=code_block_9)
bottom_point_2 = Point.ByCoordinates(x=X_2, y=Y_2, z=elevation_2)

# group: MOVE POINTS ALONG -X
XAxis_4 = Vector.XAxis()
code_block_10 = CodeBlock(B=getParameterValueByName, t=getParameterValueByName_2) { (B/2+t); }
translate_3 = Geometry.Translate(geometry=top_point_2, direction=XAxis_4, distance=code_block_10)
XAxis_5 = Vector.XAxis()
code_block_11 = CodeBlock(B=getParameterValueByName, t=getParameterValueByName_2) { (B/2+t); }
translate_4 = Geometry.Translate(geometry=bottom_point_2, direction=XAxis_5, distance=code_block_11)

# group: MOVE POINT TO TOP AND BOTTOM
X_3 = Point.X(point=end_point_inx_out_x.in)
Y_3 = Point.Y(point=end_point_inx_out_x.in)
elevation_3 = Level.Elevation(level=levels_of_bottom_of_the_wall)
bottom_point_3 = Point.ByCoordinates(x=X_3, y=Y_3, z=elevation_3)
code_block_12 = CodeBlock(x=elevation_3, y=COLUMNHEIGHT, z=offset_of_stripes) { x+y-z; }
top_point_3 = Point.ByCoordinates(x=X_3, y=Y_3, z=code_block_12)

# group: MOVE POINTS ALONG X
XAxis_6 = Vector.XAxis()
code_block_13 = CodeBlock(B=getParameterValueByName, t=getParameterValueByName_2) { -(B/2+t); }
translate_5 = Geometry.Translate(geometry=bottom_point_3, direction=XAxis_6, distance=code_block_13)
XAxis_7 = Vector.XAxis()
code_block_14 = CodeBlock(B=getParameterValueByName, t=getParameterValueByName_2) { -(B/2+t); }
translate_6 = Geometry.Translate(geometry=top_point_3, direction=XAxis_7, distance=code_block_14)

# group: MOVE POINT TO TOP AND BOTTOM
X_4 = Point.X(point=start_point_inx_out_x.in)
Y_4 = Point.Y(point=start_point_inx_out_x.in)
elevation_4 = Level.Elevation(level=levels_of_bottom_of_the_wall)
code_block_15 = CodeBlock(x=elevation_4, y=COLUMNHEIGHT, z=offset_of_stripes) { x+y-z; }
top_point_4 = Point.ByCoordinates(x=X_4, y=Y_4, z=code_block_15)
bottom_point_4 = Point.ByCoordinates(x=X_4, y=Y_4, z=elevation_4)

# group: MOVE POINTS ALONG X
XAxis_8 = Vector.XAxis()
code_block_16 = CodeBlock(B=getParameterValueByName, t=getParameterValueByName_2) { -(B/2+t); }
translate_7 = Geometry.Translate(geometry=top_point_4, direction=XAxis_8, distance=code_block_16)
XAxis_9 = Vector.XAxis()
code_block_17 = CodeBlock(B=getParameterValueByName, t=getParameterValueByName_2) { -(B/2+t); }
translate_8 = Geometry.Translate(geometry=bottom_point_4, direction=XAxis_9, distance=code_block_17)

# group: CREATE STRIPE
byStartPointEndPoint = Line.ByStartPointEndPoint(startPoint=translate, endPoint=translate_3)
byStartPointEndPoint_2 = Line.ByStartPointEndPoint(startPoint=translate_4, endPoint=translate_2)
byStartPointEndPoint_3 = Line.ByStartPointEndPoint(startPoint=translate_5, endPoint=translate_7)
byStartPointEndPoint_4 = Line.ByStartPointEndPoint(startPoint=translate_8, endPoint=translate_6)
join = List.Join(list0=byStartPointEndPoint, list1=byStartPointEndPoint_2, list2=byStartPointEndPoint_3, list3=byStartPointEndPoint_4)
upgrade_2 = Python(IN[0]=join)  # same code as upgrade
byJoinedCurves_2 = PolyCurve.ByJoinedCurves(curves=upgrade_2)
curves_3 = PolyCurve.Curves(polyCurve=byJoinedCurves_2)
flatten_4 = List.Flatten(list=curves_3)
columnByCurve = StructuralFraming.ColumnByCurve(curve=flatten_4, level=levels_of_bottom_of_the_wall, structuralColumnType=python_script)

length_2 = Curve.Length(curve=filterByBoolMask_2.in)

# group: SHORTEN X CURVE
x_curve = Python(IN[0]=filterByBoolMask_2.in)  # same code as y_curve
upgrade_3 = Python(IN[0]=x_curve)  # same code as upgrade
code_block_18 = CodeBlock { "D"; }
getParameterValueByName_4 = Element.GetParameterValueByName(element=column, parameterName=code_block_18)
code_block_19 = CodeBlock(D=getParameterValueByName_4, y=space_between_column_at_corner) { 5/2*D+y; }
pointAtSegmentLength_3 = Curve.PointAtSegmentLength(curve=x_curve, segmentLength=code_block_19)
curve_length_2 = Python(IN[0]=length_2)  # same code as y_curve
sub_2 = curve_length_2 - code_block_19
pointAtSegmentLength_4 = Curve.PointAtSegmentLength(curve=x_curve, segmentLength=sub_2)
ZIP_2 = Python(IN[0]=pointAtSegmentLength_3, IN[1]=pointAtSegmentLength_4)  # same code as ZIP
splitByPoints_2 = Curve.SplitByPoints(curve=upgrade_3, points=ZIP_2)
python_script_3 = Python(IN[0]=splitByPoints_2)  # same code as python_script_2

# group: POINT ON CURVE
code_block_20 = CodeBlock { 2; }
div = length_2 / code_block_20
pointAtSegmentLength_5 = Curve.PointAtSegmentLength(curve=filterByBoolMask_2.in, segmentLength=div)
pointsAtSegmentLengthFromPoint = Curve.PointsAtSegmentLengthFromPoint(curve=python_script_3, point=pointAtSegmentLength_5, segmentLength=space_between_column)
div_2 = length / code_block_20
pointAtSegmentLength_6 = Curve.PointAtSegmentLength(curve=filterByBoolMask_2.out, segmentLength=div_2)
pointsAtSegmentLengthFromPoint_2 = Curve.PointsAtSegmentLengthFromPoint(curve=python_script_2, point=pointAtSegmentLength_6, segmentLength=space_between_column)

# group: ADD MORE POINT TO X
x_curve_2 = Python(IN[0]=filterByBoolMask_2.in)  # same code as y_curve
code_block_21 = CodeBlock(D=getParameterValueByName_4, y=space_between_column_at_corner) { D+y; 2*D+y; 5*D/2+y; }
pointAtSegmentLength_7 = Curve.PointAtSegmentLength(curve=x_curve_2, segmentLength=code_block_21.out2)
sub_3 = curve_length_2 - code_block_21.out2
pointAtSegmentLength_8 = Curve.PointAtSegmentLength(curve=x_curve_2, segmentLength=sub_3)
pointAtSegmentLength_9 = Curve.PointAtSegmentLength(curve=x_curve_2, segmentLength=code_block_21.out0)
sub_4 = curve_length_2 - code_block_21.out0
pointAtSegmentLength_10 = Curve.PointAtSegmentLength(curve=x_curve_2, segmentLength=sub_4)
pointAtSegmentLength_11 = Curve.PointAtSegmentLength(curve=x_curve_2, segmentLength=code_block_21.out1)
sub_5 = curve_length_2 - code_block_21.out1
pointAtSegmentLength_12 = Curve.PointAtSegmentLength(curve=x_curve_2, segmentLength=sub_5)
ZIP_3 = Python(IN[0]=pointAtSegmentLength_9, IN[1]=pointAtSegmentLength_10, IN[2]=pointAtSegmentLength_11, IN[3]=pointAtSegmentLength_12)
# ---------- ZIP_3.python (18 lines) ----------
# Enable Python support and load DesignScript library
import clr
clr.AddReference('ProtoGeometry')
from Autodesk.DesignScript.Geometry import *

# The inputs to this node will be stored as a list in the IN variables.
dataEnteringNode = IN

# Place your code below this line
a=[]
for i in range(len(IN[0])):
	a.append([])
	a[i].append(IN[0][i])
	a[i].append(IN[1][i])
	a[i].append(IN[2][i])
	a[i].append(IN[3][i])
# Assign your output to the OUT variable.
OUT = a
# ----------------------------------------

# group: X GET RID OF TOO CLOSE POINT
x_points = Python(IN[0]=pointsAtSegmentLengthFromPoint)  # same code as y_curve
ZIP_4 = Python(IN[0]=pointAtSegmentLength_7, IN[1]=pointAtSegmentLength_8)
# ---------- ZIP_4.python (15 lines) ----------
# Enable Python support and load DesignScript library
import clr
clr.AddReference('ProtoGeometry')
from Autodesk.DesignScript.Geometry import *

# The inputs to this node will be stored as a list in the IN variables.
dataEnteringNode = IN
A=[]
# Place your code below this line
for i in range(len(IN[0])):
	A.append([])
	A[i].append(IN[0][i])
	A[i].append(IN[1][i])
# Assign your output to the OUT variable.
OUT = A
# ----------------------------------------
upgrade_and_duplicate_list = Python(IN[0]=ZIP_4, IN[1]=x_points)
# ---------- upgrade_and_duplicate_list.python (17 lines) ----------
# Load the Python Standard and DesignScript Libraries
import sys
import clr
clr.AddReference('ProtoGeometry')
from Autodesk.DesignScript.Geometry import *

# The inputs to this node will be stored as a list in the IN variables.
dataEnteringNode = IN

# Place your code below this line
a=[]
for i in range(len(IN[1])):
	a.append([])
	for j in range(len(IN[1][i])):
		a[i].append(IN[0][i])
# Assign your output to the OUT variable.
OUT = a
# ----------------------------------------
byTwoPoints_3 = Vector.ByTwoPoints(start=upgrade_and_duplicate_list, end=x_points)
length_3 = Vector.Length(vector=byTwoPoints_3)
lt = length_3 < minimum_space_between_column
python_script_4 = Python(IN[0]=lt)
# ---------- python_script_4.python (24 lines) ----------
# Load the Python Standard and DesignScript Libraries
import sys
import clr
clr.AddReference('ProtoGeometry')
from Autodesk.DesignScript.Geometry import *

# The inputs to this node will be stored as a list in the IN variables.
dataEnteringNode = IN

# Place your code below this line
a=[]
for i in range(len(IN[0])):
	a.append ([])
	for j in range(len(IN[0][i])):
		for n in IN[0][i][j]:
			f=0
			if n==True:
				a[i].append(True)
				f=1
				break
		if f==0:
				a[i].append(False)
# Assign your output to the OUT variable.
OUT = a
# ----------------------------------------
filterByBoolMask_3 = List.FilterByBoolMask(list=x_points, mask=python_script_4)

# group: X ADD START AND END POINT TO LIST
endPoint_3 = Curve.EndPoint(curve=filterByBoolMask_2.in)
startPoint_3 = Curve.StartPoint(curve=filterByBoolMask_2.in)
flatten_5 = List.Flatten(list=startPoint_3)
flatten_6 = List.Flatten(list=endPoint_3)
ZIP_5 = Python(IN[0]=flatten_5, IN[1]=flatten_6, IN[2]=filterByBoolMask_3.out)
# ---------- ZIP_5.python (14 lines) ----------
# Enable Python support and load DesignScript library
import clr
clr.AddReference('ProtoGeometry')
from Autodesk.DesignScript.Geometry import *

# The inputs to this node will be stored as a list in the IN variables.
dataEnteringNode = IN

# Place your code below this line
for i in range(len(IN[2])):
	IN[2][i].append(IN[0][i])
	IN[2][i].append(IN[1][i])
# Assign your output to the OUT variable.
OUT = IN[2]
# ----------------------------------------

# group: GET RIGHT SIDE OF X
byTwoPoints_4 = Vector.ByTwoPoints(start=startPoint_3, end=endPoint_3)
normalized_2 = Vector.Normalized(vector=byTwoPoints_4)
string_from_object_3 = FromObject(obj=normalized_2)
XAxis_10 = Vector.XAxis()
string_from_object_4 = FromObject(obj=XAxis_10)
eq_3 = string_from_object_3 == string_from_object_4
end_point_iny_out_y = List.FilterByBoolMask(list=endPoint_3, mask=eq_3)
start_point_iny_out_y = List.FilterByBoolMask(list=startPoint_3, mask=eq_3)

# group: MOVE POINT TO TOP AND BOTTOM
X_5 = Point.X(point=end_point_iny_out_y.out)
Y_5 = Point.Y(point=end_point_iny_out_y.out)
elevation_5 = Level.Elevation(level=levels_of_bottom_of_the_wall)
bottom_point_5 = Point.ByCoordinates(x=X_5, y=Y_5, z=elevation_5)
code_block_22 = CodeBlock(x=elevation_5, y=COLUMNHEIGHT, z=offset_of_stripes) { x+y-z; }
top_point_5 = Point.ByCoordinates(x=X_5, y=Y_5, z=code_block_22)

# group: MOVE POINTS ALONG -Y
YAxis_2 = Vector.YAxis()
code_block_23 = CodeBlock(B=getParameterValueByName, t=getParameterValueByName_2) { -(B/2+t); }
translate_9 = Geometry.Translate(geometry=bottom_point_5, direction=YAxis_2, distance=code_block_23)
YAxis_3 = Vector.YAxis()
code_block_24 = CodeBlock(B=getParameterValueByName, t=getParameterValueByName_2) { -(B/2+t); }
translate_10 = Geometry.Translate(geometry=top_point_5, direction=YAxis_3, distance=code_block_24)

# group: MOVE POINT TO TOP AND BOTTOM
X_6 = Point.X(point=start_point_iny_out_y.out)
Y_6 = Point.Y(point=start_point_iny_out_y.out)
elevation_6 = Level.Elevation(level=levels_of_bottom_of_the_wall)
code_block_25 = CodeBlock(x=elevation_6, y=COLUMNHEIGHT, z=offset_of_stripes) { x+y-z; }
top_point_6 = Point.ByCoordinates(x=X_6, y=Y_6, z=code_block_25)
bottom_point_6 = Point.ByCoordinates(x=X_6, y=Y_6, z=elevation_6)

# group: MOVE POINTS ALONG -Y
YAxis_4 = Vector.YAxis()
code_block_26 = CodeBlock(B=getParameterValueByName, t=getParameterValueByName_2) { -(B/2+t); }
translate_11 = Geometry.Translate(geometry=top_point_6, direction=YAxis_4, distance=code_block_26)
YAxis_5 = Vector.YAxis()
code_block_27 = CodeBlock(B=getParameterValueByName, t=getParameterValueByName_2) { -(B/2+t); }
translate_12 = Geometry.Translate(geometry=bottom_point_6, direction=YAxis_5, distance=code_block_27)

# group: MOVE POINT TO TOP AND BOTTOM
X_7 = Point.X(point=end_point_iny_out_y.in)
Y_7 = Point.Y(point=end_point_iny_out_y.in)
elevation_7 = Level.Elevation(level=levels_of_bottom_of_the_wall)
bottom_point_7 = Point.ByCoordinates(x=X_7, y=Y_7, z=elevation_7)
code_block_28 = CodeBlock(x=elevation_7, y=COLUMNHEIGHT, z=offset_of_stripes) { x+y-z; }
top_point_7 = Point.ByCoordinates(x=X_7, y=Y_7, z=code_block_28)

# group: MOVE POINTS ALONG Y
YAxis_6 = Vector.YAxis()
code_block_29 = CodeBlock(B=getParameterValueByName, t=getParameterValueByName_2) { (B/2+t); }
translate_13 = Geometry.Translate(geometry=bottom_point_7, direction=YAxis_6, distance=code_block_29)
YAxis_7 = Vector.YAxis()
code_block_30 = CodeBlock(B=getParameterValueByName, t=getParameterValueByName_2) { (B/2+t); }
translate_14 = Geometry.Translate(geometry=top_point_7, direction=YAxis_7, distance=code_block_30)

# group: MOVE POINT TO TOP AND BOTTOM
X_8 = Point.X(point=start_point_iny_out_y.in)
Y_8 = Point.Y(point=start_point_iny_out_y.in)
elevation_8 = Level.Elevation(level=levels_of_bottom_of_the_wall)
code_block_31 = CodeBlock(x=elevation_8, y=COLUMNHEIGHT, z=offset_of_stripes) { x+y-z; }
top_point_8 = Point.ByCoordinates(x=X_8, y=Y_8, z=code_block_31)
bottom_point_8 = Point.ByCoordinates(x=X_8, y=Y_8, z=elevation_8)

# group: MOVE POINTS ALONG Y
YAxis_8 = Vector.YAxis()
code_block_32 = CodeBlock(B=getParameterValueByName, t=getParameterValueByName_2) { (B/2+t); }
translate_15 = Geometry.Translate(geometry=top_point_8, direction=YAxis_8, distance=code_block_32)
YAxis_9 = Vector.YAxis()
code_block_33 = CodeBlock(B=getParameterValueByName, t=getParameterValueByName_2) { (B/2+t); }
translate_16 = Geometry.Translate(geometry=bottom_point_8, direction=YAxis_9, distance=code_block_33)

# group: CREATE STRIPE
byStartPointEndPoint_5 = Line.ByStartPointEndPoint(startPoint=translate_9, endPoint=translate_11)
byStartPointEndPoint_6 = Line.ByStartPointEndPoint(startPoint=translate_12, endPoint=translate_10)
byStartPointEndPoint_7 = Line.ByStartPointEndPoint(startPoint=translate_13, endPoint=translate_15)
byStartPointEndPoint_8 = Line.ByStartPointEndPoint(startPoint=translate_16, endPoint=translate_14)
join_2 = List.Join(list0=byStartPointEndPoint_5, list1=byStartPointEndPoint_6, list2=byStartPointEndPoint_7, list3=byStartPointEndPoint_8)
upgrade_4 = Python(IN[0]=join_2)  # same code as upgrade
byJoinedCurves_3 = PolyCurve.ByJoinedCurves(curves=upgrade_4)
curves_4 = PolyCurve.Curves(polyCurve=byJoinedCurves_3)
flatten_7 = List.Flatten(list=curves_4)
columnByCurve_2 = StructuralFraming.ColumnByCurve(curve=flatten_7, level=levels_of_bottom_of_the_wall, structuralColumnType=python_script)

# group (continued): ADD MORE POINT TO X
ZIP_6 = Python(IN[0]=ZIP_5, IN[1]=ZIP_3)
# ---------- ZIP_6.python (15 lines) ----------
# Enable Python support and load DesignScript library
import clr
clr.AddReference('ProtoGeometry')
from Autodesk.DesignScript.Geometry import *

# The inputs to this node will be stored as a list in the IN variables.
dataEnteringNode = IN

# Place your code below this line
for i in range(len(IN[0])):
	for n in IN[1][i]:
		IN[0][i].append(n)

# Assign your output to the OUT variable.
OUT = IN[0]
# ----------------------------------------

# group: SORT LIST BY X
X_9 = Point.X(point=ZIP_6)
sortListByAnother = archilab.Lists.Lists.SortListByAnother(list=ZIP_6, sortBy=X_9)

top_beam_height = CodeBlock { "D"; }
getParameterValueByName_5 = Element.GetParameterValueByName(element=column, parameterName=top_beam_height)
code_block_34 = CodeBlock(D=getParameterValueByName_5) { -D; }
translate_17 = Geometry.Translate(geometry=sortListByAnother.list, xTranslation=code_block_34)
code_block_35 = CodeBlock(Xpoint=translate_17) { Xpoint; }

# group: CREATE X COLUMN
byPointAndLevel = FamilyInstance.ByPointAndLevel(familyType=column, point=code_block_35, level=levels_of_bottom_of_the_wall)
code_block_36 = CodeBlock { "Top Offset"; "Top Level"; "Moves With Grids"; false; }
setParameterByName = Element.SetParameterByName(element=byPointAndLevel, parameterName=code_block_36.out0, value=COLUMNHEIGHT)
setParameterByName_2 = Element.SetParameterByName(element=setParameterByName, parameterName=code_block_36.out1, value=levels_of_bottom_of_the_wall)
setParameterByName_3 = Element.SetParameterByName(element=setParameterByName_2, parameterName=code_block_36.out2, value=code_block_36.out3)

start = Revit.Transaction.Transaction.Start(input=setParameterByName_3)

# group: ROTATE COLUMN
code_block_37 = CodeBlock { 90; -90; }
setRotation = FamilyInstance.SetRotation(familyInstance=start, degree=code_block_37.out0)
python_script_5 = Python(IN[0]=setRotation)
# ---------- python_script_5.python (21 lines) ----------
# Load the Python Standard and DesignScript Libraries
import sys
import clr
clr.AddReference('ProtoGeometry')
from Autodesk.DesignScript.Geometry import *

# The inputs to this node will be stored as a list in the IN variables.
dataEnteringNode = IN

# Place your code below this line
a=[]
for j in range(len(IN[0])):
	a.append ([])
	n=IN[0][j]
	for i in range(len(n)):
		if i ==1 or i ==(len(n)-3) or i ==(len(n)-1):
			a[j].append(True)
		else:
			a[j].append(False)		
# Assign your output to the OUT variable.
OUT = a
# ----------------------------------------
filterByBoolMask_4 = List.FilterByBoolMask(list=setRotation, mask=python_script_5)
setRotation_2 = FamilyInstance.SetRotation(familyInstance=filterByBoolMask_4.in, degree=code_block_37.out1)
python_script_6 = Python(IN[0]=setRotation, IN[1]=setRotation_2, IN[2]=setRotation)
# ---------- python_script_6.python (27 lines) ----------
# Load the Python Standard and DesignScript Libraries
import sys
import clr
clr.AddReference('ProtoGeometry')
from Autodesk.DesignScript.Geometry import *

# The inputs to this node will be stored as a list in the IN variables.
dataEnteringNode = IN

# Place your code below this line
a=[]
for i in range(len(IN[0])):
	a.append([])
	n=IN[0][i]
	x=0
	y=0
	for m in n:
		if m==True:
			a[i].append(IN[1][i][x])
			x=x+1

		else:
			a[i].append(IN[2][i][y])
			y=y+1
            	
# Assign your output to the OUT variable.
OUT = a
# ----------------------------------------
X_10 = Point.X(point=code_block_35)
Y_9 = Point.Y(point=code_block_35)
location = FamilyInstance.Location(familyInstance=setRotation)
Z = Point.Z(point=location)
byCoordinates = Point.ByCoordinates(x=X_10, y=Y_9, z=Z)
filterByBoolMask_5 = List.FilterByBoolMask(list=byCoordinates, mask=python_script_5)
code_block_38 = CodeBlock { "D"; "B"; }
getParameterValueByName_6 = Element.GetParameterValueByName(element=column, parameterName=code_block_38.out0)
code_block_39 = CodeBlock(d=getParameterValueByName_6) { d; }
translate_18 = Geometry.Translate(geometry=filterByBoolMask_5.in, xTranslation=code_block_39)
reassemble = Python(IN[0]=python_script_5, IN[1]=translate_18, IN[2]=filterByBoolMask_5.out)  # same code as python_script_6
getParameterValueByName_7 = Element.GetParameterValueByName(element=column, parameterName=code_block_38.out1)
python_script_7 = Python(IN[0]=reassemble, IN[1]=getParameterValueByName_6, IN[2]=getParameterValueByName_7)
# ---------- python_script_7.python (22 lines) ----------
# Load the Python Standard and DesignScript Libraries
import sys
import clr
clr.AddReference('ProtoGeometry')
from Autodesk.DesignScript.Geometry import *

# The inputs to this node will be stored as a list in the IN variables.
dataEnteringNode = IN

# Place your code below this line
a=[]
B=IN[2]
D=IN[1]
for i in range(len(IN[0])):
	a.append ([])
	for j in range(len(IN[0][i])):
		if j == (len(IN[0][i])-1) or j == (len(IN[0][i])-2) or j == (len(IN[0][i])-3) :
			a[i].append(B/2)
		elif j == 0 or j == 1 or 2 :
			a[i].append(D-B/2)		
# Assign your output to the OUT variable.
OUT = a
# ----------------------------------------
translate_19 = Geometry.Translate(geometry=reassemble, xTranslation=python_script_7)
setLocation = Element.SetLocation(element=python_script_6, geometry=translate_19)

end = Revit.Transaction.Transaction.End(input=setLocation)
firstItem = List.FirstItem(list=code_block_35@@L2)
lastItem = List.LastItem(list=code_block_35@@L2)
byStartPointEndPoint_9 = Line.ByStartPointEndPoint(startPoint=firstItem, endPoint=lastItem)

# group: Y GET RID OF TOO CLOSE POINT
y_points = Python(IN[0]=pointsAtSegmentLengthFromPoint_2)  # same code as y_curve
ZIP_7 = Python(IN[0]=flatten_2, IN[1]=flatten_3)  # same code as ZIP_4
upgrade_and_duplicate_list_2 = Python(IN[0]=ZIP_7, IN[1]=y_points)  # same code as upgrade_and_duplicate_list
byTwoPoints_5 = Vector.ByTwoPoints(start=upgrade_and_duplicate_list_2, end=y_points)
length_4 = Vector.Length(vector=byTwoPoints_5)
lt_2 = length_4 < minimum_space_between_column
python_script_8 = Python(IN[0]=lt_2)  # same code as python_script_4
filterByBoolMask_6 = List.FilterByBoolMask(list=y_points, mask=python_script_8)

# group (continued): Y ADD START AND END POINT TO LIST
python_script_9 = Python(IN[0]=flatten_2, IN[1]=flatten_3, IN[2]=filterByBoolMask_6.out)  # same code as ZIP_5

# group: SORT LIST BY Y
Y_10 = Point.Y(point=python_script_9)
code_block_40 = CodeBlock { true; }
sortListByAnother_2 = archilab.Lists.Lists.SortListByAnother(list=python_script_9, sortBy=Y_10, reversed=code_block_40)

firstItem_2 = List.FirstItem(list=sortListByAnother_2.list@@L2)
lastItem_2 = List.LastItem(list=sortListByAnother_2.list@@L2)
byStartPointEndPoint_10 = Line.ByStartPointEndPoint(startPoint=firstItem_2, endPoint=lastItem_2)
join_3 = List.Join(list0=byStartPointEndPoint_9, list1=byStartPointEndPoint_10)
top_beam_height_2 = CodeBlock { "D"; }
getParameterValueByName_8 = Element.GetParameterValueByName(element=beam, parameterName=top_beam_height_2)
code_block_41 = CodeBlock(D=getParameterValueByName_8) { D; }

# group: TOP BEAM
XY = Plane.XY()
elevation_9 = Level.Elevation(level=levels_of_bottom_of_the_wall)
code_block_42 = CodeBlock(x=elevation_9, y=COLUMNHEIGHT, D=code_block_41) { x+y-D; }
offset = Plane.Offset(plane=XY, dist=code_block_42)
pullOntoPlane = Curve.PullOntoPlane(curve=join_3, plane=offset)

start_2 = Revit.Transaction.Transaction.Start(input=pullOntoPlane)

# group (continued): TOP BEAM
beamByCurve = StructuralFraming.BeamByCurve(curve=start_2, level=levels_of_bottom_of_the_wall, structuralFramingType=beam)

# group: ROTATE BEAM
code_block_43 = CodeBlock { "Cross-Section Rotation"; 180; }
setParameterByName_4 = Element.SetParameterByName(element=beamByCurve, parameterName=code_block_43.out0, value=code_block_43.out1)

end_2 = Revit.Transaction.Transaction.End(input=setParameterByName_4)
code_block_44 = CodeBlock(A=elevation_9, B=code_block_41) { A+B; }

# group: BOTTOM BEAM
XY_2 = Plane.XY()
offset_2 = Plane.Offset(plane=XY_2, dist=code_block_44)
pullOntoPlane_2 = Curve.PullOntoPlane(curve=join_3, plane=offset_2)

start_3 = Revit.Transaction.Transaction.Start(input=pullOntoPlane_2)

# group (continued): BOTTOM BEAM
beamByCurve_2 = StructuralFraming.BeamByCurve(curve=start_3, level=levels_of_bottom_of_the_wall, structuralFramingType=beam)

end_3 = Revit.Transaction.Transaction.End(input=beamByCurve_2)

# group: REFORM CURVE X
byStartPointEndPoint_11 = Line.ByStartPointEndPoint(startPoint=pointAtSegmentLength_7, endPoint=pointAtSegmentLength_8)
python_script_10 = Python(IN[0]=byStartPointEndPoint_11)
# ---------- python_script_10.python (17 lines) ----------
# Load the Python Standard and DesignScript Libraries
import sys
import clr
clr.AddReference('ProtoGeometry')
from Autodesk.DesignScript.Geometry import *

# The inputs to this node will be stored as a list in the IN variables.
dataEnteringNode = IN


# Place your code below this line
a=[]
for n in IN[0]:
	a.append ([n])

# Assign your output to the OUT variable.
OUT = a
# ----------------------------------------
byJoinedCurves_4 = PolyCurve.ByJoinedCurves(curves=python_script_10)
curves_5 = PolyCurve.Curves(polyCurve=byJoinedCurves_4)
ZIP_8 = Python(IN[0]=pointAtSegmentLength_7, IN[1]=pointAtSegmentLength_8)
# ---------- ZIP_8.python (17 lines) ----------
# Enable Python support and load DesignScript library
import clr
clr.AddReference('ProtoGeometry')
from Autodesk.DesignScript.Geometry import *

# The inputs to this node will be stored as a list in the IN variables.
dataEnteringNode = IN

# Place your code below this line
a=[]
for i in range(len(IN[0])):
	a.append([])
	a[i].append(IN[0][i])
	a[i].append(IN[1][i])

# Assign your output to the OUT variable.
OUT = a
# ----------------------------------------
x_point_for_beam = Python(IN[0]=filterByBoolMask_3.out, IN[1]=ZIP_8)  # same code as ZIP_6

# group: SPLITED CURVE
splitByPoints_3 = Curve.SplitByPoints(curve=curves_5, points=x_point_for_beam)
splitByPoints_4 = Curve.SplitByPoints(curve=python_script_2, points=python_script_9)
join_4 = List.Join(list0=splitByPoints_3, list1=splitByPoints_4)
flatten_8 = List.Flatten(list=join_4)

height_of_top_beam_2_2 = CodeBlock(HEIGHT=height_of_top_beam_2) { HEIGHT; }

# group: TOP BEAM 2
XY_3 = Plane.XY()
elevation_10 = Level.Elevation(level=levels_of_bottom_of_the_wall)
code_block_45 = CodeBlock(x=elevation_10, y=height_of_top_beam_2_2, D=code_block_41) { x+y-D; }
offset_3 = Plane.Offset(plane=XY_3, dist=code_block_45)
pullOntoPlane_3 = Curve.PullOntoPlane(curve=flatten_8, plane=offset_3)

start_4 = Revit.Transaction.Transaction.Start(input=pullOntoPlane_3)

# group (continued): TOP BEAM 2
beamByCurve_3 = StructuralFraming.BeamByCurve(curve=start_4, level=levels_of_bottom_of_the_wall, structuralFramingType=beam)

# group: ROTATE BEAM
code_block_46 = CodeBlock { "Cross-Section Rotation"; 180; }
setParameterByName_5 = Element.SetParameterByName(element=beamByCurve_3, parameterName=code_block_46.out0, value=code_block_46.out1)

end_4 = Revit.Transaction.Transaction.End(input=setParameterByName_5)
height_of_middle_beam_2 = CodeBlock(HEIGHT=height_of_middle_beam) { HEIGHT; }

# group: MIDDLE BEAM
XY_4 = Plane.XY()
elevation_11 = Level.Elevation(level=levels_of_bottom_of_the_wall)
code_block_47 = CodeBlock(x=elevation_11, y=height_of_middle_beam_2, D=code_block_41) { x+y-D; }
offset_4 = Plane.Offset(plane=XY_4, dist=code_block_47)
pullOntoPlane_4 = Curve.PullOntoPlane(curve=flatten_8, plane=offset_4)

start_5 = Revit.Transaction.Transaction.Start(input=pullOntoPlane_4)

# group (continued): MIDDLE BEAM
beamByCurve_4 = StructuralFraming.BeamByCurve(curve=start_5, level=levels_of_bottom_of_the_wall, structuralFramingType=beam)

# group: ROTATE BEAM
code_block_48 = CodeBlock { "Cross-Section Rotation"; 180; }
setParameterByName_6 = Element.SetParameterByName(element=beamByCurve_4, parameterName=code_block_48.out0, value=code_block_48.out1)

end_5 = Revit.Transaction.Transaction.End(input=setParameterByName_6)

# group: CREATE Y COLUMN
byPointAndLevel_2 = FamilyInstance.ByPointAndLevel(familyType=column, point=sortListByAnother_2.list, level=levels_of_bottom_of_the_wall)
code_block_49 = CodeBlock { "Top Offset"; "Top Level"; "Moves With Grids"; false; }
setParameterByName_7 = Element.SetParameterByName(element=byPointAndLevel_2, parameterName=code_block_49.out0, value=COLUMNHEIGHT)
setParameterByName_8 = Element.SetParameterByName(element=setParameterByName_7, parameterName=code_block_49.out1, value=levels_of_bottom_of_the_wall)
setParameterByName_9 = Element.SetParameterByName(element=setParameterByName_8, parameterName=code_block_49.out2, value=code_block_49.out3)
firstItem_3 = List.FirstItem(list=setParameterByName_9@@L2)
code_block_50 = CodeBlock { 180; }
setRotation_3 = FamilyInstance.SetRotation(familyInstance=firstItem_3, degree=code_block_50)

code_block_51 = CodeBlock(ypoint=sortListByAnother_2.list) { ypoint; }
firstItem_4 = List.FirstItem(list=code_block_51@@L2)
setLocation_2 = Element.SetLocation(element=setRotation_3, geometry=firstItem_4)
