# Dynamo graph Wall-Top Beam and Bottom Beam.dyn (Dynamo 2.2.1.5175)

# group: Select input elements, structure into connection nodes and take sub nodes of 2 elements.
select_steel_elements = SelectStructureData()  # 8 picked in the model; graph input
byObjects = AdvanceSteel.ConnectionAutomation.Nodes.ConnectionNode.FromStructure(objects=select_steel_elements)  # "Node.ByObjects"
code_block = CodeBlock { 2; }
getSubNodesOfSize = AdvanceSteel.ConnectionAutomation.Nodes.ConnectionNode.SubNodesOfSize(node=byObjects, noOfZones=code_block)  # "Node.GetSubNodesOfSize"

# group: Define the zones for which the elements are joining to each other to create a connection.
code_block_2 = CodeBlock { 0; "End"; }
byZoneType = AdvanceSteel.ConnectionAutomation.Nodes.Filter.ByZoneType(node=getSubNodesOfSize, index=code_block_2.out0, zoneType=code_block_2.out1)
code_block_3 = CodeBlock { 1; "End"; }
byZoneType_2 = AdvanceSteel.ConnectionAutomation.Nodes.Filter.ByZoneType(node=byZoneType.accepted, index=code_block_3.out0, zoneType=code_block_3.out1)

# group: Filter the input elements based on slant angle of the elements using a range from 0 to 90 degrees for both input elements.
code_block_4 = CodeBlock { 0; }
beam_1_slope_angle_range_from = DoubleInput(0)  # graph input
beam_1_slope_angle_range_to = DoubleInput(90)  # graph input
bySlopeAngle = AdvanceSteel.ConnectionAutomation.Nodes.Filter.BySlopeAngle(node=byZoneType_2.accepted, index=code_block_4, rangeStart=beam_1_slope_angle_range_from, rangeEnd=beam_1_slope_angle_range_to)
code_block_5 = CodeBlock { 1; }
beam_2_slope_angle_range_from = DoubleInput(0)  # graph input
beam_2_slope_angle_range_to = DoubleInput(90)  # graph input
bySlopeAngle_2 = AdvanceSteel.ConnectionAutomation.Nodes.Filter.BySlopeAngle(node=bySlopeAngle.accepted, index=code_block_5, rangeStart=beam_2_slope_angle_range_from, rangeEnd=beam_2_slope_angle_range_to)

# group: Filter accepted input elements, based on Section Name. Apex Haunch connection is supported only when both input elements have same Section Name.
code_block_6 = CodeBlock { 0; }
main_and_secondary_input = StructuralDataTypes("Any | Any")  # "Main and secondary input elements section"; graph input
bySectionName = AdvanceSteel.ConnectionAutomation.Nodes.Filter.BySectionType(node=bySlopeAngle_2.accepted, index=code_block_6, nameToFind=main_and_secondary_input.typeName)  # "Filter.BySectionName"
code_block_7 = CodeBlock { 1; }
bySectionName_2 = AdvanceSteel.ConnectionAutomation.Nodes.Filter.BySectionType(node=bySectionName.accepted, index=code_block_7, nameToFind=main_and_secondary_input.typeName)  # "Filter.BySectionName"

# group: Creates Apex Haunch connection taking indexes as order for input elements.
code_block_8 = CodeBlock { [0,1]; }
connection_type_to_add_in_model = ConnectionTypes("Wall-top and bottom beam | Wall-top and bottom beam")  # graph input
byType = AdvanceSteel.ConnectionAutomation.Nodes.Connection.ByType(node=bySectionName_2.accepted, indexes=code_block_8, connectionType=connection_type_to_add_in_model)

# group: Display number of created connections per run.
code_block_9 = CodeBlock { false; }
clean = List.Clean(list=byType, preserveIndices=code_block_9)
flatten = List.Flatten(list=clean)
count = List.Count(list=flatten)
number_of_created_connections = Watch(count)  # graph output
