# Dynamo graph Wall-Top and Bottom of Wall.dyn (Dynamo 2.2.1.5175)

# group: Select input elements and structure them into connection nodes and take sub nodes of 2 elements.
select_steel_elements = SelectStructureData()  # 112 picked in the model; graph input
byObjects = AdvanceSteel.ConnectionAutomation.Nodes.ConnectionNode.FromStructure(objects=select_steel_elements)  # "Node.ByObjects"
code_block = CodeBlock { 2; }
getSubNodesOfSize = AdvanceSteel.ConnectionAutomation.Nodes.ConnectionNode.SubNodesOfSize(node=byObjects, noOfZones=code_block)  # "Node.GetSubNodesOfSize"

# group: Define the zones for which the elements are joining to each other to create a connection.
code_block_2 = CodeBlock { 0; "Body"; }
byZoneType = AdvanceSteel.ConnectionAutomation.Nodes.Filter.ByZoneType(node=getSubNodesOfSize, index=code_block_2.out0, zoneType=code_block_2.out1)
code_block_3 = CodeBlock { 1; "End"; }
byZoneType_2 = AdvanceSteel.ConnectionAutomation.Nodes.Filter.ByZoneType(node=byZoneType.accepted, index=code_block_3.out0, zoneType=code_block_3.out1)

# group: Filter input elements to identify the beam orientation cases supported by the clip angle connection using a filter for the angle made by the vectors of the input elements axis. E.g: the clip angle connection connects the main and second elements using straight angle cleats, the connection is not created if the cleats need to be skewed in order to connect the input elements.
code_block_4 = CodeBlock { 0; 1; "y"; "y"; 89; 90; }
byAngleBetweenAxes = AdvanceSteel.ConnectionAutomation.Nodes.Filter.ByAngleBetweenAxes(node=byZoneType_2.accepted, indexFirst=code_block_4.out0, indexSecond=code_block_4.out1, axisFirst=code_block_4.out2, axisSecond=code_block_4.out3, rangeStart=code_block_4.out4, rangeEnd=code_block_4.out5)
code_block_5 = CodeBlock { 0; 1; "y"; "y"; 0; 1; }
byAngleBetweenAxes_2 = AdvanceSteel.ConnectionAutomation.Nodes.Filter.ByAngleBetweenAxes(node=byAngleBetweenAxes.rejected, indexFirst=code_block_5.out0, indexSecond=code_block_5.out1, axisFirst=code_block_5.out2, axisSecond=code_block_5.out3, rangeStart=code_block_5.out4, rangeEnd=code_block_5.out5)
list_create = List.Create(item0=byAngleBetweenAxes.accepted, item1=byAngleBetweenAxes_2.accepted)

# group: Create Clip Angle connection taking indexes as order for input elements.
code_block_6 = CodeBlock { [0,1]; }
connection_type_to_add_in_model = ConnectionTypes("END OF WALLS | END OF WALLS")  # graph input
byType = AdvanceSteel.ConnectionAutomation.Nodes.Connection.ByType(node=list_create, indexes=code_block_6, connectionType=connection_type_to_add_in_model)

# group: Display number of created connections per run.
code_block_7 = CodeBlock { false; }
clean = List.Clean(list=byType, preserveIndices=code_block_7)
flatten = List.Flatten(list=clean)
count = List.Count(list=flatten)
number_of_created_connections = Watch(count)  # graph output
